# Dynamo graph Home.dyn (Dynamo 0.8.2.2392)

code_block = CodeBlock { {"p1", "p2", "p3", "p4", "p5"}; }
code_block_2 = CodeBlock { 100; }
randomList = Math.RandomList(code_block_2)
code_block_3 = CodeBlock(x=randomList) { x*100; }
code_block_4 = CodeBlock { 5; }
chop = List.Chop(code_block_3, code_block_4)
integer_slider = IntegerSlider(9, range=0..24 step 1)
getItemAtIndex = List.GetItemAtIndex(list=chop, index=integer_slider)
parallelCoordinates = ParallelCoordinates(code_block, getItemAtIndex, color=0, values="System.Collections.Generic.List`1[System.Collections.Generic.List`1[System.Double]]")
watch2D = Watch2D(getItemAtIndex, color=0)
